# Dynamo graph Dyn_XX_DynamoPlayer_DeleteUnusedViewFilters.dyn "Dyn_XX_DynamoPlayer_DeleteUnusedViewFilters-" (Dynamo 2.12.0.5650)

# note: Variables / Inputs
# Red indicates Variables that can be altered per project and must be set accordingly before running the script.
# note: Working / Functions
# Green indicates the working of the script. No changes should be made in these groups unless advised.
# note: Checking / Outputs
# Orange indicates checking nodes to ensure the script has deployed correctly.
# note: Important stuff
# Purple will indicate something important is going on here.

# group: Revit file!
# note: Use this file in combination with the following Revit file:
# ?.rvt

# group: Dyn_04_List Mgmt
# note: Contents
# 1.Create List
# 2. List Lacing (mgmt)
# 3. List Flatten and Sort
# 	• Lacing + Sort + Extra Sort
# 4. Model element selection query
# 5. BoolMask
# 6. List Cycle | Repeat | Unique items
# 7. List Mix | Max (values)
# 8. List IndexOf
# 9. Remap Range!
# 10. List Shuffle | Reverse
# 11. List Join | Create
# 12. List Transpose!
# 13. List Flatten | Chop list
# 14. Take | Drop EveryNthItem
# 15. List Count @ level
# 16. List Get item at index (@level)
# 14. List.Map??
# 15. List ReplaceItemAtIndex
# 16. List Lacing (Auto, Shortest, Longest, Cross)
# Practical example!
# 	• Extract total area of each wall type? (List.GroupByKey)

# group: Select all Elements
code_block = CodeBlock()
# ---------- code_block.designscript (3 lines) ----------
// Select all elements of input categories
cats = Category.ByName("Rooms");
ElementQueries.OfCategory(cats);
# ----------------------------------------

# group: Flatten and Get Parameter Values
code_block_2 = CodeBlock(input_elements=code_block.out1)  # unwired: param_name
# ---------- code_block_2.designscript (6 lines) ----------
//Flatten the list
elements = List.Flatten(input_elements);

// Get Parameter values
level_val = Elements.Element.GetParameterValueByName(elements,param_name);
level_val.Name;
# ----------------------------------------

# group: Group Elements by Level
code_block_3 = CodeBlock(input_list=code_block_2.elements, keys_list=code_block_2.level_val) { grouped_list = List.GroupByKey(input_list,keys_list); Dictionary.ValueAtKey(grouped_list, "groups"); }

# group: Create a Dictionary based on Level keys
code_block_4 = CodeBlock(input_list=code_block_2.out2)
# ---------- code_block_4.designscript (4 lines) ----------
keys_list = List.UniqueItems(input_list);
values_list = ["01F","01L"];

Dictionary.ByKeysValues(keys_list, values_list);
# ----------------------------------------

# group: Get Values at Keys based on Level
code_block_5 = CodeBlock(elements=code_block_3.out1, input_dictionary=code_block_4.out2)  # unwired: param_name
# ---------- code_block_5.designscript (6 lines) ----------
// Get Parameter values
level_val = Elements.Element.GetParameterValueByName(elements,param_name);
level_name = level_val.Name;


Dictionary.ValueAtKey(input_dictionary,level_name);
# ----------------------------------------

# group: Create Sequence values
code_block_6 = CodeBlock(input=code_block_3.out1)
# ---------- code_block_6.designscript (9 lines) ----------
count= List.Count(input@L2<1>);

// Sequence values
seq_val = 1..count..1;
// Convert values to String
seq_string = seq_val+"";

// Match sequence values to 3 lenght by padding
String.PadLeft(seq_string,3,"0");
# ----------------------------------------

# group: Concatenate
code_block_7 = CodeBlock(level=code_block_5.out2, seq=code_block_6.out3) { level+"."+seq; }

# group: Set Parameter Values
code_block_8 = CodeBlock(elements=code_block_3.out1, param_values=code_block_7)  # unwired: param_name
# ---------- code_block_8.designscript (2 lines) ----------
// Get Parameter values
Elements.Element.SetParameterByName(elements,param_name,param_values);
# ----------------------------------------

# group: Checking elements
watch = Watch(code_block.out1)

# group: Getting all Filters
code_block_9 = CodeBlock { type = Types.FindTypeByNameInAssembly("FilterElement","RevitAPI"); ElementQueries.OfElementType(type); }

# group: Get all Filters in Model
element_types = ElementTypes("FilterElement")
all_elements_of_type = ElementsOfType(element_type=element_types)
name = Element.Name(element=all_elements_of_type)

# group: Category input
specify_category_of_elements_to = Categories("OST_Views")  # "Specify Category of Elements to update"; graph input

# group: Select All Elements
all_elements_of_category = ElementsOfCategory(Category=specify_category_of_elements_to)

# group: Clean the list
boolean = BoolSelector(false)
clean = List.Clean(list=all_elements_of_category, preserveIndices=boolean)

# group: Getting View Filters
filters = View.Filters(view=clean)
flatten = List.Flatten(list=filters)
uniqueItems = List.UniqueItems(list=flatten)

# group: Checking elements
watch_2 = Watch(uniqueItems)

# group: Filter and Remove used Filters
indexOf = List.IndexOf(list=all_elements_of_type, element=uniqueItems)
removeItemAtIndex = List.RemoveItemAtIndex(list=all_elements_of_type, indices=indexOf)

# group: Delete Unsued Filters
delete = Element.Delete(element=removeItemAtIndex)  # frozen

name_2 = Element.Name(element=removeItemAtIndex)

# group: Checking elements
view_filters_not_in_use = Watch(name_2)  # graph output
