# Dynamo graph Dyn_XX_DynamoPlayer_RenameBySpline.dyn "RenameBySpline" (Dynamo 2.12.0.5650)

# note: Important stuff
# Purple will indicate something important is going on here.
# note: Checking / Outputs
# Orange indicates checking nodes to ensure the script has deployed correctly.
# note: Working / Functions
# Green indicates the working of the script. No changes should be made in these groups unless advised.
# note: Variables / Inputs
# Red indicates Variables that can be altered per project and must be set accordingly before running the script.

# group: Dyn_XX_DynPlayer_ RenameBySpline
# note: Workflow
# To be filled in!

# group: Prefix for room number
prefix_for_room_number = StringInput("00")  # graph input

# group: Category input
rooms_or_areas = StringInput("Rooms")  # graph input

# group: Collect Category By View
byName = Category.ByName(name=rooms_or_areas)
code_block = CodeBlock { document = Document.Current; active_view = Document.ActiveView(document); }
all_elements_of_category_in_view = ElementsOfCategoryInView(Category=byName, View=code_block.active_view)

# group: If Statement!
code_block_2 = CodeBlock(cat=rooms_or_areas, input=all_elements_of_category_in_view)
# ---------- code_block_2.designscript (3 lines) ----------
cat == "Rooms" ? Room.FinishBoundary(input) :
cat == "Areas" ? Revit.Area.Boundaries(input) :
cat == "Spaces" ? Space.FinishBoundary(input) : false;
# ----------------------------------------

# group: Spline input
select_spline = DSModelElementSelection()  # 1 picked in the model

geometry = Element.Geometry(element=select_spline)

# group: Pull Curves to XY plane
byJoinedCurves = PolyCurve.ByJoinedCurves(curves=code_block_2)
firstItem = List.FirstItem(list=byJoinedCurves@L2)
XY = Plane.XY()
pullOntoPlane = Curve.PullOntoPlane(curve=firstItem, plane=XY)
pullOntoPlane_2 = Curve.PullOntoPlane(curve=geometry, plane=XY)

# group: Filter Only Rooms covered in Spline
doesIntersect = Geometry.DoesIntersect(geometry=pullOntoPlane, other=pullOntoPlane_2, lacing=Longest)
filterByBoolMask = List.FilterByBoolMask(list=all_elements_of_category_in_view, mask=doesIntersect)
filterByBoolMask_2 = List.FilterByBoolMask(list=pullOntoPlane, mask=doesIntersect)

# group: Sorted Rooms based on Curve
intersect = Geometry.Intersect(geometry=filterByBoolMask_2.in, other=pullOntoPlane_2, lacing=Longest)
firstItem_2 = List.FirstItem(list=intersect@L2)
parameterAtPoint = Curve.ParameterAtPoint(curve=pullOntoPlane_2, point=firstItem_2, lacing=Longest)
sortByKey = List.SortByKey(list=filterByBoolMask.in, keys=parameterAtPoint)

code_block_3 = CodeBlock { "Number"; }

# group: Number Sequence
count = List.Count(list=sortByKey.sortedList)
code_block_4 = CodeBlock { 1; }
range = Range(start=code_block_4, end=count)
string_from_object = FromObject(object=range)
code_block_5 = CodeBlock { 3; "0"; }
padLeft = String.PadLeft(string=string_from_object, newLength=code_block_5.out0, padChars=code_block_5.out1)

# group: Prefix Level Parameter
code_block_6 = CodeBlock { "Level"; }
getParameterValueByName = Element.GetParameterValueByName(element=sortByKey.sortedList, parameterName=code_block_6)
uniqueItems = List.UniqueItems(list=getParameterValueByName)
code_block_7 = CodeBlock { " "; }
split = String.Split(string=uniqueItems, separator0=code_block_7)
firstItem_3 = List.FirstItem(list=split@L2)
flatten = List.Flatten(list=firstItem_3)
cycle = List.Cycle(list=flatten, amount=count)

code_block_8 = CodeBlock(a=cycle, b=padLeft) { a + "." + b; }
setParameterByName = Element.SetParameterByName(element=sortByKey.sortedList, parameterName=code_block_3, value=code_block_8)
list_create = List.Create(item0=setParameterByName, item1=code_block_8)
transpose = List.Transpose(lists=list_create)

# group: Output
rooms_updated = Watch(transpose)  # graph output
