# Dynamo graph Dyn_XX_DynamoPlayer_RenumberByCategory.dyn (Dynamo 2.12.0.5650)

# note: Variables / Inputs
# Red indicates Variables that can be altered per project and must be set accordingly before running the script.
# note: Working / Functions
# Green indicates the working of the script. No changes should be made in these groups unless advised.
# note: Checking / Outputs
# Orange indicates checking nodes to ensure the script has deployed correctly.
# note: Important stuff
# Purple will indicate something important is going on here.

# group: Revit file!
# note: Use this file in combination with the following Revit file:
# ?.rvt

# group: Dyn_04_List Mgmt
# note: Contents
# 1.Create List
# 2. List Lacing (mgmt)
# 3. List Flatten and Sort
# 	• Lacing + Sort + Extra Sort
# 4. Model element selection query
# 5. BoolMask
# 6. List Cycle | Repeat | Unique items
# 7. List Mix | Max (values)
# 8. List IndexOf
# 9. Remap Range!
# 10. List Shuffle | Reverse
# 11. List Join | Create
# 12. List Transpose!
# 13. List Flatten | Chop list
# 14. Take | Drop EveryNthItem
# 15. List Count @ level
# 16. List Get item at index (@level)
# 14. List.Map??
# 15. List ReplaceItemAtIndex
# 16. List Lacing (Auto, Shortest, Longest, Cross)
# Practical example!
# 	• Extract total area of each wall type? (List.GroupByKey)

# group: Categories to Select
specify_category_to_number = Categories("OST_Doors")  # graph input

# group: Select all Elements
code_block = CodeBlock(cats=specify_category_to_number)
# ---------- code_block.designscript (2 lines) ----------
// Select all elements of input categories
ElementQueries.OfCategory(cats);
# ----------------------------------------

# group: Checking elements
watch = Watch(code_block)

# group: Input Parameter to read
input_parameter_to_group_number = StringInput("Level")  # "Input Parameter to Group/Number By"; graph input

# group: Flatten and Get Parameter Values
code_block_2 = CodeBlock(input_elements=code_block, param_name=input_parameter_to_group_number)
# ---------- code_block_2.designscript (6 lines) ----------
//Flatten the list
elements = List.Flatten(input_elements);

// Get Parameter values
level_val = Elements.Element.GetParameterValueByName(elements,param_name);
level_val.Name;
# ----------------------------------------

# group: Group Elements by Level
code_block_3 = CodeBlock(input_list=code_block_2.elements, keys_list=code_block_2.level_val) { grouped_list = List.GroupByKey(input_list,keys_list); Dictionary.ValueAtKey(grouped_list, "groups"); }

# group: Input Parameter to write
specify_parameter_of_elements_to = StringInput("Mark")  # "Specify Parameter of Elements to update with number"; graph input

# group: Create a Dictionary based on Level keys
code_block_4 = CodeBlock(input_list=code_block_2.out2)
# ---------- code_block_4.designscript (4 lines) ----------
keys_list = List.UniqueItems(input_list);
values_list = ["01F","01L"];

Dictionary.ByKeysValues(keys_list, values_list);
# ----------------------------------------

# group: Get Values at Keys based on Level
code_block_5 = CodeBlock(elements=code_block_3.out1, param_name=input_parameter_to_group_number, input_dictionary=code_block_4.out2)
# ---------- code_block_5.designscript (6 lines) ----------
// Get Parameter values
level_val = Elements.Element.GetParameterValueByName(elements,param_name);
level_name = level_val.Name;


Dictionary.ValueAtKey(input_dictionary,level_name);
# ----------------------------------------

# group: Create Sequence values
code_block_6 = CodeBlock(input=code_block_3.out1)
# ---------- code_block_6.designscript (9 lines) ----------
count= List.Count(input@L2<1>);

// Sequence values
seq_val = 1..count..1;
// Convert values to String
seq_string = seq_val+"";

// Match sequence values to 3 lenght by padding
String.PadLeft(seq_string,3,"0");
# ----------------------------------------

# group: Concatenate
code_block_7 = CodeBlock(level=code_block_5.out2, seq=code_block_6.out3) { level+"."+seq; }

# group: Set Parameter Values
code_block_8 = CodeBlock(elements=code_block_3.out1, param_name=specify_parameter_of_elements_to, param_values=code_block_7)  # frozen
# ---------- code_block_8.designscript (2 lines) ----------
// Get Parameter values
Elements.Element.SetParameterByName(elements,param_name,param_values);
# ----------------------------------------

# group: Split Categories input and Select All Elements
all_elements_of_category = ElementsOfCategory(Category=specify_category_to_number)

# group: Checking elements
watch_2 = Watch(all_elements_of_category)

# group: Get Level Parameter
flatten = List.Flatten(list=all_elements_of_category)
getParameterValueByName = Element.GetParameterValueByName(element=flatten, parameterName=input_parameter_to_group_number)
name = Element.Name(element=getParameterValueByName)

# group: Group Element by Level
groupByKey = List.GroupByKey(list=flatten, keys=getParameterValueByName)

# group: Create Dictionary by Level values
uniqueItems = List.UniqueItems(list=name)
code_block_9 = CodeBlock { " "; }
split = String.Split(string=name, separator0=code_block_9)
code_block_10 = CodeBlock { 0; }
getItemAtIndex = List.GetItemAtIndex(list=split@L2, index=code_block_10)
byKeysValues = DesignScript.Builtin.Dictionary.ByKeysValues(keys=uniqueItems, values=getItemAtIndex)

# group: Get Values per Key based on Dictionary
getParameterValueByName_2 = Element.GetParameterValueByName(element=groupByKey.groups, parameterName=input_parameter_to_group_number)
name_2 = Element.Name(element=getParameterValueByName_2)
valueAtKey = DesignScript.Builtin.Dictionary.ValueAtKey(dictionary=byKeysValues, key=name_2)

# group: Count Element instances
count = List.Count(list=groupByKey.groups@L2)

# group: Number Range per Level
code_block_11 = CodeBlock { 1; }
range = Range(start=code_block_11, end=count, step=code_block_11)
string_from_object = FromObject(object=range)
code_block_12 = CodeBlock { 3; "0"; }
padLeft = String.PadLeft(string=string_from_object, newLength=code_block_12.out0, padChars=code_block_12.out1)

# group: Concatenate
code_block_13 = CodeBlock(level=valueAtKey, seq=padLeft) { level+"."+seq; }

# group: Set Parameter Values
setParameterByName = Element.SetParameterByName(element=groupByKey.groups, parameterName=specify_parameter_of_elements_to, value=code_block_13)

# group: Reporting If Statement
isEmpty = List.IsEmpty(list=setParameterByName)
isNull = Object.IsNull(object=setParameterByName)
list_create = List.Create(item0=isEmpty, item1=isNull)
anyTrue = List.AnyTrue(list=list_create)
code_block_14 = CodeBlock { "No Elements updated, check Category and Parameter Name"; }
if_ = RefactoredIf(test=anyTrue, true=code_block_14, false=setParameterByName)

# group: Checking elements
watch_3 = Watch(if_)
