# Dynamo graph Dyn_XX_DynamoPlayer_WriteParameters.dyn (Dynamo 2.12.0.5650)

# note: Variables / Inputs
# Red indicates Variables that can be altered per project and must be set accordingly before running the script.
# note: Working / Functions
# Green indicates the working of the script. No changes should be made in these groups unless advised.
# note: Checking / Outputs
# Orange indicates checking nodes to ensure the script has deployed correctly.
# note: Important stuff
# Purple will indicate something important is going on here.

# group: Revit file!
# note: Use this file in combination with the following Revit file:
# ?.rvt

# group: Dyn_04_List Mgmt
# note: Contents
# 1.Create List
# 2. List Lacing (mgmt)
# 3. List Flatten and Sort
# 	• Lacing + Sort + Extra Sort
# 4. Model element selection query
# 5. BoolMask
# 6. List Cycle | Repeat | Unique items
# 7. List Mix | Max (values)
# 8. List IndexOf
# 9. Remap Range!
# 10. List Shuffle | Reverse
# 11. List Join | Create
# 12. List Transpose!
# 13. List Flatten | Chop list
# 14. Take | Drop EveryNthItem
# 15. List Count @ level
# 16. List Get item at index (@level)
# 14. List.Map??
# 15. List ReplaceItemAtIndex
# 16. List Lacing (Auto, Shortest, Longest, Cross)
# Practical example!
# 	• Extract total area of each wall type? (List.GroupByKey)

# group: Categories to Select
input_categories_to_select_use_a = StringInput("Walls,Floors,Ceilings")  # "Input Categories to Select. Use a comma "," to input multiple values"; graph input

# group: Select all Elements
code_block = CodeBlock(input_names=input_categories_to_select_use_a)
# ---------- code_block.designscript (6 lines) ----------
// Split input String into a List
names = String.Split(input_names,",");

// Select all elements of input categories
cats = Category.ByName(names);
ElementQueries.OfCategory(cats);
# ----------------------------------------

# group: Checking elements
watch = Watch(code_block.out2)

# group: Input Parameter to read
string = StringInput("Phase Created")  # graph input

# group: Flatten and Get Parameter Values
code_block_2 = CodeBlock(input_elements=code_block.out2, param_name=string)
# ---------- code_block_2.designscript (6 lines) ----------
//Flatten the list
elements = List.Flatten(input_elements);

// Get Parameter values
Elements.Element.GetParameterValueByName(elements,param_name);
Elements.Element.GetParameterValueByName(elements,"Workset");
# ----------------------------------------

# group: Input Parameter to write
string_2 = StringInput("Comments")  # graph input

# group: Worksets Collector
python_script = Python()  # CPython3; unwired: IN[0]
# ---------- python_script.python (27 lines) ----------
# Load the Python Standard and DesignScript Libraries
import clr
clr.AddReference("RevitNodes")
import Revit
clr.ImportExtensions(Revit.Elements)
clr.ImportExtensions(Revit.GeometryConversion)
clr.AddReference("RevitServices")
import RevitServices
from RevitServices.Persistence import DocumentManager
from RevitServices.Transactions import TransactionManager
clr.AddReference("RevitAPI")
import Autodesk
from Autodesk.Revit.DB import *

# The inputs to this node will be stored as a list in the IN variables.
doc = DocumentManager.Instance.CurrentDBDocument


# Place your code below this line
worksets = FilteredWorksetCollector(doc).OfKind(WorksetKind.UserWorkset).ToWorksets()

names = [w.Name for w in worksets]

ids = [w.Id.IntegerValue for w in worksets]

# Assign your output to the OUT variable.
OUT = [worksets, names, ids]
# ----------------------------------------

string_from_object = FromObject(object=python_script)
code_block_3 = CodeBlock(input=string_from_object) { k = input[2]; v = input[1]; }
byKeysValues = DesignScript.Builtin.Dictionary.ByKeysValues(keys=code_block_3.k, values=code_block_3.v)
string_from_object_2 = FromObject(object=code_block_2.out2)
valueAtKey = DesignScript.Builtin.Dictionary.ValueAtKey(dictionary=byKeysValues, key=string_from_object_2)

# group: Set Parameter Values
code_block_4 = CodeBlock(input_elements=code_block_2.elements, param_name=string_2, param_values=valueAtKey)
# ---------- code_block_4.designscript (5 lines) ----------
//Flatten the list
elements = List.Flatten(input_elements);

// Get Parameter values
Elements.Element.SetParameterByName(elements,param_name,param_values);
# ----------------------------------------

code_block_5 = CodeBlock { ","; }
split = String.Split(string=input_categories_to_select_use_a, separator0=code_block_5)
byName = Category.ByName(name=split)
all_elements_of_category = ElementsOfCategory(Category=byName)
watch_2 = Watch(all_elements_of_category)
flatten = List.Flatten(list=all_elements_of_category)
code_block_6 = CodeBlock { "Workset"; }
getParameterValueByName = Element.GetParameterValueByName(element=flatten, parameterName=code_block_6)
string_from_object_3 = FromObject(object=getParameterValueByName)
getParameterValueByName_2 = Element.GetParameterValueByName(element=flatten, parameterName=string)
name = Element.Name(element=getParameterValueByName_2)
setParameterByName = Element.SetParameterByName(element=flatten, parameterName=string_2, value=name)
setParameterByName_2 = Element.SetParameterByName(element=flatten)  # unwired: parameterName, value
