# Dynamo graph Dyn_XX_WriteParameters.dyn (Dynamo 2.12.0.5650)

# note: Variables / Inputs
# Red indicates Variables that can be altered per project and must be set accordingly before running the script.
# note: Working / Functions
# Green indicates the working of the script. No changes should be made in these groups unless advised.
# note: Checking / Outputs
# Orange indicates checking nodes to ensure the script has deployed correctly.
# note: Important stuff
# Purple will indicate something important is going on here.

# group: Revit file!
# note: Use this file in combination with the following Revit file:
# ?.rvt

# group: Dyn_04_List Mgmt
# note: Contents
# 1.Create List
# 2. List Lacing (mgmt)
# 3. List Flatten and Sort
# 	• Lacing + Sort + Extra Sort
# 4. Model element selection query
# 5. BoolMask
# 6. List Cycle | Repeat | Unique items
# 7. List Mix | Max (values)
# 8. List IndexOf
# 9. Remap Range!
# 10. List Shuffle | Reverse
# 11. List Join | Create
# 12. List Transpose!
# 13. List Flatten | Chop list
# 14. Take | Drop EveryNthItem
# 15. List Count @ level
# 16. List Get item at index (@level)
# 14. List.Map??
# 15. List ReplaceItemAtIndex
# 16. List Lacing (Auto, Shortest, Longest, Cross)
# Practical example!
# 	• Extract total area of each wall type? (List.GroupByKey)

# group: Categories to Select
input_categories_to_select_use_a = StringInput("Walls,Floors,Ceilings")  # "Input Categories to Select. Use a comma "," to input multiple values"; graph input
categories = Categories("OST_Walls")  # graph input

# group: Select all Elements
all_elements_of_category = ElementsOfCategory(Category=categories)

# group: Checking elements
watch = Watch(all_elements_of_category)

# group: Input Parameter to read
string = StringInput("Workset")  # graph input

# group: Get Parameter Values
getParameterValueByName = Element.GetParameterValueByName(element=all_elements_of_category, parameterName=string)

# group: Worksets Collector
python_script = Python()  # CPython3; unwired: IN[0]
# ---------- python_script.python (27 lines) ----------
# Load the Python Standard and DesignScript Libraries
import clr
clr.AddReference("RevitNodes")
import Revit
clr.ImportExtensions(Revit.Elements)
clr.ImportExtensions(Revit.GeometryConversion)
clr.AddReference("RevitServices")
import RevitServices
from RevitServices.Persistence import DocumentManager
from RevitServices.Transactions import TransactionManager
clr.AddReference("RevitAPI")
import Autodesk
from Autodesk.Revit.DB import *

# The inputs to this node will be stored as a list in the IN variables.
doc = DocumentManager.Instance.CurrentDBDocument


# Place your code below this line
worksets = FilteredWorksetCollector(doc).OfKind(WorksetKind.UserWorkset).ToWorksets()

names = [w.Name for w in worksets]

ids = [w.Id.IntegerValue for w in worksets]

# Assign your output to the OUT variable.
OUT = [worksets, names, ids]
# ----------------------------------------

code_block = CodeBlock(input=python_script) { k = input[2]; v = input[1]; }
byKeysValues = DesignScript.Builtin.Dictionary.ByKeysValues(keys=code_block.v, values=code_block.k)

# group: Workset Name
string_2 = StringInput("Workset1")  # graph input

valueAtKey = DesignScript.Builtin.Dictionary.ValueAtKey(dictionary=byKeysValues, key=string_2)

# group: Set Parameter Values
setParameterByName = Element.SetParameterByName(element=all_elements_of_category, parameterName=string, value=valueAtKey, lacing=Longest)

# group: Checking elements
changed_elements = Watch(setParameterByName)  # graph output
